# Dynamo graph Samples-Simple-GetProjects.dyn (Dynamo 1.3.0.875)

# note: Replace below with your Asana API key.
string = StringInput("Bearer 0/xxxxxxxxxxxxxxxxxxxxxxxxxxxxxxxxxxxxxx")
client = Asana.Client.Client(string)
getWorkspaces = Asana.Client.GetWorkspaces(client)
# note: We are limiting results to first Workspace returned, but only for the purpose of this example.
firstItem = List.FirstItem(getWorkspaces)
id = Asana.Classes.Workspace.Id(firstItem)
getProjectsByWorkspace = Asana.Client.GetProjectsByWorkspace(client, id)
id_2 = Asana.Classes.Project.Id(getProjectsByWorkspace)
watch = Watch(id_2)
name = Asana.Classes.Project.Name(getProjectsByWorkspace)
watch_2 = Watch(name)
