# Dynamo graph Samples-Simple-GetTaskById.dyn (Dynamo 1.3.0.875)

# note: Replace below with your Asana API key.
string = StringInput("Bearer xxxxxxxxxxxxxxxxxxxxxxxxxxxxxxxxxxx")
# note: The client requires a string input, so you could alternatively use the "GetKeyFromXMLFile" node to read the key from an XML file saved on your computer.
# When deploying this in your organisation, it would be a good idea to save this file to a read-only location on your network and point to it in your scripts.
client = Asana.Client.Client(string)
# note: Replace number below with an Asana task ID. This can easily be found by looking at  the last portion of the URL in the browser when viewing a task in the Asana web application, or by selecting "Copy Task URL" from the task's menu.
string_2 = StringInput("299852053647462")
getById = Asana.Task.GetById(client, string_2)
notes = Asana.Task.Notes(getById)
watch = Watch(notes)
name = Asana.Task.Name(getById)
watch_2 = Watch(name)
# note: The integration returns Asana objects which need to be deconstructed to access their properties.
# Note : also works with DesignScript.
id = Asana.Task.Id(getById)
watch_3 = Watch(id)
createdAt = Asana.Task.CreatedAt(getById)
watch_4 = Watch(createdAt)
code_block = CodeBlock(task=getById) { task.Id; }
watch_5 = Watch(code_block)
projects = Asana.Task.Projects(getById)
id_2 = Asana.Project.Id(projects)
watch_6 = Watch(id_2)
name_2 = Asana.Project.Name(projects)
watch_7 = Watch(name_2)
tags = Asana.Task.Tags(getById)
# note: Tag ID & Name are retrieved as part of the Task object, but any further Tag properties need to be retrieved using the GetTagByID node.
id_3 = Asana.Tag.Id(tags)
getById_2 = Asana.Tag.GetById(client, id_3)
color = Asana.Tag.Color(getById_2)
watch_8 = Watch(color)
createdAt_2 = Asana.Tag.CreatedAt(getById_2)
watch_9 = Watch(createdAt_2)
name_3 = Asana.Tag.Name(tags)
