# Dynamo graph Samples-Simple-GetTasksByProject.dyn (Dynamo 1.3.0.875)

# note: Replace below with your Asana API key.
string = StringInput("Bearer xxxxxxxxxxxxxxxxxxxxxxxxxxxxxxxxxxxxxx")
client = Asana.Client.Client(string)
# note: Replace below with an Asana project ID. This can easily be found by looking at the middle portion of the URL in the browser when viewing a task in the Asana web application or using the GetProjects nodes.
string_2 = StringInput("xxxxxxxxxxxxxxxxx")
getTasksByProject = Asana.Client.GetTasksByProject(client, string_2)
notes = Asana.Classes.Task.Notes(getTasksByProject)
watch = Watch(notes)
name = Asana.Classes.Task.Name(getTasksByProject)
watch_2 = Watch(name)
# note: The integration returns Asana objects which need to be deconstructed to access their properties.
# Note : also works with DesignScript.
id = Asana.Classes.Task.Id(getTasksByProject)
watch_3 = Watch(id)
code_block = CodeBlock(task=getTasksByProject) { task.Id; }
watch_4 = Watch(code_block)
tags = Asana.Classes.Task.Tags(getTasksByProject)
color = Asana.Classes.Tag.Color(tags)
watch_5 = Watch(color)
name_2 = Asana.Classes.Tag.Name(tags)
watch_6 = Watch(name_2)
